# Grasshopper definition chars.gh (Grasshopper 1.0.7)
# plug-ins: ChopChop, LunchBox, eleFront, Human

# ---- group: Set these once (before editing geometry) and never change them again
chararcter_set_local_path = Panel("char_set\chars_printable_ASCII.txt")
monospace_center_chars_horizontally = BooleanToggle(False)
rule_x = Slider(5, range=0..20)
rule_y = Slider(7, range=0..20)
header = Panel("""font: 5x7 printable ASCII
version: 1
date: 2023-11-30
author: awesome-llama
notes: None""")
char_max_height = Slider(20, range=0..32)
local_origin_x = Slider(4, range=0..20)
local_origin_y = Slider(7, range=0..20)
char_max_width = Slider(20, range=0..32)
header_2 = Text(header)

# ---- group: Preview settings
monospace_only_text_preview = Panel("This is a test!")
preview_line_thickness = BooleanToggle(True)
show_rule_lines = BooleanToggle(True)

# ---- group: Click this whenever a change to geometry is made
load_geometry_from_layers = Button()

# ---- group: chopchop, not required
# Process characters from Rhino and output font data
chopchop = ChopChop()

# ---- group: Click this to save
generate_sb3_file_and_save = Button()

# ----
rootdirectory = GhPythonScript()  # -> Dir
# ---------- rootdirectory: Python ----------
"""Provides a scripting component.
    Inputs:
        x: The x script variable
        y: The y script variable
    Output:
        Dir: Directory of current document"""

__author__ = "Atlas"
__version__ = "2024.01.05"

import rhinoscriptsyntax as rs
import os
import Rhino

Dir = ''


gh_doc = Rhino.RhinoDoc.ActiveDoc # Get the current Grasshopper document

# Check if a Grasshopper document is open
if gh_doc is not None:
    # Get the path of the Grasshopper document

    if gh_doc.Path is not None:
        
        doc_directory = os.path.dirname(gh_doc.Path) # Get the directory of the document
        print("Document Directory:", doc_directory)
        Dir = str(doc_directory) + '\\'
    else:
        print("The document has not been saved.")
        
else:
    print("No Grasshopper document is currently open.")
# ---------- end rootdirectory ----------
layer_names = Panel("Lines")

gradgeo = GradGeo()  # -> geo_4, col_2; disabled
previewlw = CustomPreviewLineweights(Geometry=gradgeo.geo_4, Shader=gradgeo.col_2, Thickness=10, Absolute=False)  # disabled

layer_ref = LayerReference(ReferenceToggle=invert(load_geometry_from_layers), LayerName=layer_names)  # -> Geometry, Name, UserStrings, GUID

concat = Concatenate(FragmentA=rootdirectory, FragmentB=chararcter_set_local_path)
file = ReadFile(File=concat, PerLineParse=True)  # -> flatten(Content)
cset = CreateSet(List=file)  # -> Set, Map
charset = Text(flatten(cset.Set))

pt = ConstructPoint(XCoordinate=char_max_width, YCoordinate=char_max_height, ZCoordinate=0)
pt_2 = ConstructPoint(XCoordinate=local_origin_x, YCoordinate=local_origin_y, ZCoordinate=0)
pt_3 = ConstructPoint(XCoordinate=rule_x, YCoordinate=rule_y, ZCoordinate=0)
char_geo = Geometry(layer_ref.Geometry)

join = TextJoin(Text=charset, Join=" ")
panel = Panel(join)

# ---- group: grid pts / grid shape
number_slider = Slider(8, range=0..20)
number_slider_2 = Slider(50, range=0..100)

# ---- group: grid pts
pdecon = Deconstruct(Point=pt)  # -> XComponent, YComponent, ZComponent
addition = Addition(A=pdecon.XComponent, B=2)
addition_2 = Addition(A=pdecon.YComponent, B=6)
recgrid = Rectangular(Plane=PlaneXY(0, 0, 0), SizeX=addition, SizeY=expr("-x", addition_2), ExtentX=number_slider, ExtentY=number_slider_2)  # -> Cells, Points
flip = FlipMatrix(Data=recgrid.Points)  # -> flatten(Data)
charset_2 = Text(charset)
short = ShortestList(ListA=charset_2, ListB=flip, TrimMode=2)  # -> ListA, ListB
pt_4 = Point(flip)

# ----
charset_3 = Text(charset)
lng = ListLength(List=charset_3)
guide_geometry = GuideGeometry(global_location=short.ListB, max_size=pt, local_origin_offset=pt_2, rule=pt_3)  # -> tag_loc_2, rec_2, rule_4, origin_2

# ---- group: find which char each geo corresponds to
filtertype = FilterByType(ObjectType="Point", Geometry=char_geo, invertFilter=False, returnNulls=False)  # -> ExcludedGeometry, IncludedGeometry
srf = Surface(guide_geometry.rec_2)
simplify = SimplifyCurve(Curve=filtertype.ExcludedGeometry)  # -> Curve, Simplified
srf_cp = SurfaceClosestPoint(Point=graft(filtertype.IncludedGeometry), Surface=srf)  # -> Point, UVPoint, Distance
c_smallest_index = CSharpScript(L=srf_cp.Distance)  # -> i; inputs L: list of Double
# ---------- c_smallest_index: C# ----------
    int smallest_int = 0;
    double smallest_val = L[0];

    for (int index = 1; index < L.Count; index++) {
      if (L[index] < smallest_val) {
        smallest_int = index;
        smallest_val = L[index];
      }
    }

    i = smallest_int;
# ---------- end c_smallest_index ----------
colom = CollisionOneMany(Collider=simplify.Curve, Obstacles=srf)  # -> Collision, Index
trim = TrimTree(Tree=c_smallest_index, Depth=1)
merge = Merge(Data1=colom.Index, Data2=trim)
merge_2 = Merge(Data1=simplify.Curve, Data2=filtertype.IncludedGeometry)

# ----
setindex = GhPythonScript(max_index=lng, index=merge, L=merge_2)  # -> Tree; inputs index: list, L: list of GeometryBase
# ---------- setindex: Python ----------
"""Create a tree with each list item added to a branch based on an index
    Inputs:
        x: The x script variable
        y: The y script variable
    Output:
        a: The a output variable"""

__author__ = "Atlas"
__version__ = "2023.11.30"

import rhinoscriptsyntax as rs
from Grasshopper import DataTree
import Grasshopper.Kernel.Data.GH_Path as ghpath
import ghpythonlib.treehelpers as th

Tree = DataTree[object]()

data = [[] for _ in range(max_index)]

for i, l in zip(index, L):
    if i >= 0: # must be a valid index
        data[i].append(l)
        #Tree.Add(l, ghpath(0,i))
    
Tree = th.list_to_tree(data)
# ---------- end setindex ----------

# ---- group: center at world origin
pt_5 = Point(graft(guide_geometry.origin_2))
rev = Reverse(Vector=pt_5)
move = Move(Geometry=setindex, Motion=rev)  # -> Geometry, Transform

# ---- group: preview
show_lines = Boolean(preview_line_thickness)
gate = StreamGate(Stream=char_geo, Gate=show_lines)  # -> Target0, Target1
srfs = Srfs(geo=gate.Target1)
material = CreateMaterial(
    Diffuse=ColourSwatch(SwatchColor=RGB(66, 66, 66)),
    Specular=RGB(255, 255, 255),
    Emission=RGB(0, 0, 0),
    Transparency=0,
    Shine=0)
preview = CustomPreview(Geometry=srfs, Material=material)

# ----
show_rl = Boolean(show_rule_lines)
gate_2 = StreamGate(Stream=guide_geometry.rule_4, Gate=show_rl)  # -> Target0, Target1
gate_3 = StreamGate(Stream=guide_geometry.tag_loc_2, Gate=show_rl)  # -> Target0, Target1
gate_4 = StreamGate(Stream=guide_geometry.rec_2, Gate=show_rl)  # -> Target0, Target1
swatch = ColourSwatch(SwatchColor=RGB(255, 255, 255))
preview_2 = CustomPreview(Geometry=gate_4.Target1, Material=swatch)
preview_3 = CustomPreview(Geometry=gate_2.Target1, Material=ColourSwatch(SwatchColor=RGBA(61, 227, 227, 112)))
tag = TextTag(Location=gate_3.Target1, Text=charset, Colour=swatch)

monospace = Boolean(monospace_center_chars_horizontally)
gate_5 = StreamGate(Stream=move.Geometry, Gate=monospace)  # -> Target0, Target1
center = Center(geo=gate_5.Target1, rule_pt=pt_3)
filter = StreamFilter(Gate=monospace, Stream0=gate_5.Target0, Stream1=center)

# ---- group: width
rule_pt = Point(pt_3)
charset_4 = Text(charset)
lng_2 = ListLength(List=charset_4)
pdecon_2 = Deconstruct(Point=rule_pt)  # -> XComponent, YComponent, ZComponent
bbox = BoundingBox(Content=filter, Plane=PlaneXY(0, 0, 0), UnionBox=True)  # -> Box, Box_2
repeat = RepeatData(Data=pdecon_2.XComponent, Length=lng_2)
debox = DeconstructBox(Box=bbox.Box)  # -> Plane, X, Y, Z
trim_2 = TrimTree(Tree=repeat, Depth=1)  # -> graft(Tree)
dedomain = DeconstructDomain(Domain=debox.X)  # -> Start, End
monospace_2 = Boolean(monospace_center_chars_horizontally)
filter_2 = StreamFilter(Gate=monospace_2, Stream0=dedomain.End, Stream1=trim_2)

# ----
group = Group(Objects=filter)
chars = Characters(Text=monospace_only_text_preview)  # -> Result, Unicode
charset_5 = Text(charset)
X = UnitX(Factor=6)
lng_3 = ListLength(List=chars.Result)
pt_6 = Point(Point(10, 40, 0))
keysearch = KeyValueSearch(Keys=charset_5, Values=flatten(group), Search=chars.Result)
arrlinear = LinearArray(Geometry=pt_6, Direction=X, Count=lng_3)  # -> Geometry, Transform
move_2 = Move(Geometry=keysearch, Motion=arrlinear.Geometry)  # -> Geometry, Transform

# ----
# font list format
# 
# char_[char]
# index
# width
# number of items (incl. above)
# ===
# number of strokes
# ---
# > stroke length - 1
# > pos x
# > pos y
# > ...
# > ...
charset_6 = Text(charset)
lng_4 = ListLength(List=charset_6)
series = Series(Start=0, Step=1, Count=lng_4)
trim_3 = TrimTree(Tree=series, Depth=1)
charset_7 = Text(graft(charset))
concat_2 = Concatenate(FragmentA="index_", FragmentB=graft(trim_3))
concat_3 = Concatenate(FragmentA="char_", FragmentB=charset_7)
char = Text(concat_2)
name = Text(concat_3)

instruction = GhPythonScript(Geo=filter)  # -> Ins; inputs Geo: GeometryBase
# ---------- instruction: Python ----------
__author__ = "Atlas"
__version__ = "2023.11.30"

import rhinoscriptsyntax as rs
import Rhino.Geometry as rg
import ghpythonlib.components as ghc


#print dir(Geo)
#print str(Geo.__class__)
Ins = []
if str(type(Geo)) == "<type 'Point'>":
    pt = ghc.Deconstruct(Geo)
    Ins = [
        '---',
        0,
        round(pt[0]),
        round(pt[1]),
    ]
elif str(type(Geo)) == "<type 'NoneType'>":
    print type(Geo)
    Ins = []  #how to handle no strokes at all?
else: #str(type(Geo)) == "<type 'PolylineCurve'>":
    verts = ghc.Explode(Geo, True)[1]
    Ins = ['---']
    Ins.append(len(verts)-1)
    for vert in verts:
        Ins.append(round(vert.X))
        Ins.append(round(vert.Y))
    
#else:
#    print type(Geo)
# ---------- end instruction ----------
lng_5 = ListLength(List=instruction)
trim_4 = TrimTree(Tree=lng_5, Depth=1)
trim_5 = TrimTree(Tree=instruction, Depth=1)
len = GhPythonScript(x=trim_4)  # -> a; inputs x: list
# ---------- len: Python ----------
__author__ = "Atlas"
__version__ = "2023.11.30"

import rhinoscriptsyntax as rs

# get correct len
# necessary because no instructions should remain as 0, not 1

if x == [0]:
    a = 0
else:
    a = len(x)
# ---------- end len ----------
stroke_count = Integer(len)
strokes = Data(trim_5)

ungroup = Ungroup(Group=move_2.Geometry)
srfs_2 = Srfs(geo=ungroup)
material_2 = CreateMaterial(
    Diffuse=ColourSwatch(SwatchColor=RGB(66, 66, 66)),
    Specular=RGB(255, 255, 255),
    Emission=RGB(0, 0, 0),
    Transparency=0,
    Shine=0)
preview_4 = CustomPreview(Geometry=srfs_2, Material=material_2)

min_width = Slider(1, range=0..10)
nullrep = ReplaceNulls(Items=filter_2, Replacements=0)  # -> Items, Count
max = Maximum(A=nullrep.Items, B=min_width)
width = Number(max)

charset_8 = Text(charset)
lng_6 = ListLength(List=charset_8)
repeat_2 = RepeatData(Data="...", Length=lng_6)
trim_6 = TrimTree(Tree=repeat_2, Depth=1)  # -> graft(Tree)

charset_9 = Text(charset)
lng_7 = ListLength(List=charset_9)
repeat_3 = RepeatData(Data="===", Length=lng_7)
trim_7 = TrimTree(Tree=repeat_3, Depth=1)  # -> graft(Tree)

merge_3 = Merge(Data1=name, Data2=char, Data3=width)
merge_4 = Merge(Data1=trim_7, Data2=stroke_count, Data3=strokes, Data4=trim_6)
lng_8 = ListLength(List=merge_4)
lng_9 = ListLength(List=merge_3)
addition_3 = Addition(A=lng_9, B=lng_8, C=0)
charset_10 = Text(charset)
merge_5 = Merge(Data1=merge_3, Data2=addition_3, Data3=merge_4)
lng_10 = ListLength(List=charset_10)
repeat_4 = RepeatData(Data="-1", Length=lng_10)  # -> flatten(Data)
header_3 = Text(header_2)
flatten = FlattenTree(Tree=merge_5, Path="{0}")
merge_6 = Merge(Data1=header_3, Data2="!CHARACTER_LOOKUP:", Data3=repeat_4, Data4="!CHARACTER_DATA:", Data5=flatten)
charset_11 = Text(charset)
python_generate_list_data = GhPythonScript(Charset=charset_11, Data=merge_6)  # -> Output; inputs Charset: list, Data: list
# ---------- python_generate_list_data: Python ----------
"""Provides a scripting component.
    Inputs:
        Charset: characters
        Data: List data to be processed
    Output:
        Output: Final list data"""

__author__ = "Atlas"
__version__ = "2023.11.30"

import rhinoscriptsyntax as rs

# first get the index of the LUT
LUT_START = 7
PREFIX = 'char_'

for i, char in enumerate(Charset):
    search_str = PREFIX + char
    index = Data.index(search_str, LUT_START+len(Charset))
    assert Data[index][len(PREFIX)] == char
    
    print search_str, index
    
    Data[i+LUT_START] = index + 1 # scratch is 1-indexed
    
    #if True:
    #    Data[index+1] = 'xxx'

Output = Data
# ---------- end python_generate_list_data ----------

srcfolder = Panel("src\")
destfolder = Panel("output\")
concat_4 = Concatenate(FragmentA=rootdirectory, FragmentB=destfolder)
concat_5 = Concatenate(FragmentA=rootdirectory, FragmentB=srcfolder)
destfolder_path = FilePath(concat_4)
srcfolder_path = FilePath(concat_5)

panel_2 = Panel(python_generate_list_data)
or = GateOr(A=Button(), B=generate_sb3_file_and_save)
charset_12 = Text(charset)

python_save_font = GhPythonScript(run=Button(), DestFolder=destfolder_path, data=flatten(python_generate_list_data))  # inputs data: list
# ---------- python_save_font: Python ----------
"""Standalone save font as text file.
    Inputs:
        run: Set to True
        DestFolder: Where to save the file
        data: Font data
    Output:
        a: The a output variable"""

__author__ = "Atlas"
__version__ = "2023.11.27"

import rhinoscriptsyntax as rs
import codecs

if run:
    print DestFolder
    with codecs.open(DestFolder+'font.txt' , 'w', encoding='utf-8') as f:
        f.writelines([str(d)+'\n' for d in data])
else:
    print 'disabled'
# ---------- end python_save_font ----------

generate_template_project = GhPythonScript(
    Run=or,
    SrcFolder=srcfolder_path,
    DestFolder=destfolder_path,
    Charset=flatten(charset_12),
    ListData=flatten(python_generate_list_data))  # -> out, project_json; inputs Charset: list, ListData: list
# ---------- generate_template_project: Python ----------
__author__ = "Atlas"
__version__ = "2023.12.03"

#import rhinoscriptsyntax as rs
import json
from zipfile import ZipFile
import codecs

print 'source: ' + SrcFolder
print 'destination: ' + DestFolder

if Run:
    with codecs.open(SrcFolder + 'project.json', encoding='utf-8') as f:
        project = json.loads(f.read())
    
    # AGENT:
    project['meta']['agent'] = 'Grasshopper'
    
    # SET THE COMMENT: 
    project['targets'][1]['comments'] = {
        "info": 
            {
            "blockId": None,
            "x": -246,
            "y": -217,
            "width": 334,
            "height": 120,
            "minimized": False,
            "text": ', '.join(ListData[0:6])
            }
    }
    #project['targets'][1]['comments']['aa']['text'] = ', '.join(ListData[0:6])
    
    # SET THE LIST DATA:
    project['targets'][1]['lists']['BaURS`^reFjB4Qfsb|#T'][1] = ListData
    
    # SET THE COSTUMES:
    project['targets'][1]['costumes'] = project['targets'][1]['costumes'][0:2] # keep the first 2
    for char in Charset:
        project['targets'][1]['costumes'].append({
            "rotationCenterX": 0,
            "rotationCenterY": 0,
            "name": str(char),
            "dataFormat": "svg",
            "md5ext": "3339a2953a3bf62bb80e54ff575dbced.svg",
            "assetId": "3339a2953a3bf62bb80e54ff575dbced",
            "bitmapResolution": 1
        })
    
    project_json = [project]
    
    with codecs.open(DestFolder+'project.json', 'w', encoding='utf-8') as f:
        f.write(json.dumps(project, encoding='utf-8', ensure_ascii=False, indent=2))
    
    
    # ZIP
    with ZipFile(DestFolder+'PTE_generated.sb3', 'w') as zipObj:
        zipObj.write(DestFolder+'project.json', 'project.json')
        # costumes
        zipObj.write(SrcFolder+'3339a2953a3bf62bb80e54ff575dbced.svg', '3339a2953a3bf62bb80e54ff575dbced.svg')
        zipObj.write(SrcFolder+'bcc12c24d26096b0d151f6b6a71dcf93.svg', 'bcc12c24d26096b0d151f6b6a71dcf93.svg')
        zipObj.write(SrcFolder+'cd21514d0531fdffb22204e0ec5ed84a.svg', 'cd21514d0531fdffb22204e0ec5ed84a.svg')
    
    print('Success!')
# ---------- end generate_template_project ----------
generate_sb3_debug_log = Panel(generate_template_project.out)
panel_3 = Panel(generate_template_project.project_json)

getkeys = GhPythonScript(Data=generate_template_project.project_json)  # -> S
# ---------- getkeys: Python ----------
"""Preview JSON data structure
    Inputs:
        JSON: JSON data as string
    Output:
        S: Structure"""

__author__ = "Atlas"
__version__ = "2023.07.29"

import rhinoscriptsyntax as rs
import json



def get_data(data, level=0):
    indent = '  '*(level)
    
    if isinstance(data, dict):
        if len(data) == 0:
            return '[]'
        
        expandable = False
        # determine if the dict is worth expanding (contains extra objects)
        for item in data.items():
            if isinstance(item[1], dict) or isinstance(item[1], list):
                expandable = True
                break # found something to expand
        
        if expandable:
            result = []
            for key, value in data.items():
                result.append("{0}:{1}".format(key, get_data(value, level+1)))
            
            return indent+'{\n'+indent+'  '+str((",\n"+indent+'  ').join(result))+'\n'+indent+'}'
        
        return '{'+str(len(data))+' items}'
    elif isinstance(data, list):
        if len(data) == 0:
            return '[]'
        
        if isinstance(data[0], dict) or isinstance(data[0], list):
            result = []
            i = 0
            for item in data:
                result.append(get_data(item, level+1))
                i += 1
                if i > 0:
                    result.append('...')
                    break
            return "[\n{1}{0}\n{1}]".format(", ".join(result), indent)
        
        return "[{0} items]".format(len(data))
    else:
        return str(type(data).__name__)

if Data is not None:
    object = Data#json.loads(Data)
    S = get_data(object)
    #print(get_data([1,2,3,4]))

    print(object.keys())
# ---------- end getkeys ----------
panel_5 = Panel(getkeys)

# ==== cluster GuideGeometry: Generate the guide data and rule lines
local_origin_offset = ClusterInput()
global_location = ClusterInput()
max_size = ClusterInput()
rule = ClusterInput()
local_origin_offset_2 = Point(local_origin_offset)
max_size_2 = Point(max_size)
global_location_2 = Point(global_location)
rule_2 = Point(rule)
pt = Point(Point(1, 1, 0))
addition = Addition(A=local_origin_offset_2, B=rule_2)
addition_2 = Addition(A=max_size_2, B=pt)
pdecon = Deconstruct(Point=addition_2)  # -> XComponent, YComponent, ZComponent

pt_2 = Point(Point(0.5, 1, 0))
multiplication = Multiplication(A=max_size_2, B=pt_2)
pt_3 = Point(Point(0, 2, 0))
addition_3 = Addition(A=multiplication, B=pt_3)
addition_4 = Addition(A=global_location_2, B=addition_3)

addition_5 = Addition(A=global_location_2, B=max_size_2)
half_pt = Point(Point(0.5, 0.5, 0))

pdecon_2 = Deconstruct(Point=local_origin_offset_2)  # -> XComponent, YComponent, ZComponent
subtraction = Subtraction(A=global_location_2, B=half_pt)
X = UnitX(Factor=pdecon_2.XComponent)
Y = UnitY(Factor=pdecon_2.YComponent)
move = Move(Geometry=subtraction, Motion=X)  # -> Geometry, Transform
move_2 = Move(Geometry=subtraction, Motion=Y)  # -> Geometry, Transform
X_2 = UnitX(Factor=1)
Y_2 = UnitY(Factor=1)
line = LineSDL(Start=move.Geometry, Direction=Y_2, Length=pdecon.YComponent)
line_2 = LineSDL(Start=move_2.Geometry, Direction=X_2, Length=pdecon.XComponent)

pdecon_3 = Deconstruct(Point=addition)  # -> XComponent, YComponent, ZComponent
X_3 = UnitX(Factor=pdecon_3.XComponent)
Y_3 = UnitY(Factor=pdecon_3.YComponent)
move_3 = Move(Geometry=subtraction, Motion=X_3)  # -> Geometry, Transform
move_4 = Move(Geometry=subtraction, Motion=Y_3)  # -> Geometry, Transform
X_4 = UnitX(Factor=1)
Y_4 = UnitY(Factor=1)
line_3 = LineSDL(Start=move_3.Geometry, Direction=Y_4, Length=pdecon.YComponent)
line_4 = LineSDL(Start=move_4.Geometry, Direction=X_4, Length=pdecon.XComponent)

addition_6 = Addition(A=addition_5, B=half_pt)
subtraction_2 = Subtraction(A=global_location_2, B=half_pt)
rec_2pt = Rectangle2Pt(Plane=PlaneXY(0, 0, 0), PointA=subtraction_2, PointB=addition_6, Radius=0)  # -> Rectangle, Length
rec = Rectangle(rec_2pt.Rectangle)
tag_loc = Point(addition_4)
merge = Merge(Data1=graft(line), Data2=graft(line_2), Data3=graft(line_3), Data4=graft(line_4))
addition_7 = Addition(A=global_location_2, B=local_origin_offset_2)
rec_2 = ClusterOutput(rec)
tag_loc_2 = ClusterOutput(tag_loc)
group = Group(Objects=merge)
origin = Point(addition_7)
trim = TrimTree(Tree=group, Depth=1)
rule_3 = Geometry(trim)
origin_2 = ClusterOutput(origin)
rule_4 = ClusterOutput(rule_3)

# ==== cluster GradGeo: Create a gradient for a list of geometry
geo = ClusterInput()
geo_2 = Geometry(geo)
lng = ListLength(List=geo_2)
range = Range(Domain=Domain(0, 1), Steps=lng)
gradient = Gradient(
    LowerLimit=0,
    UpperLimit=1,
    Parameter=range,
    stops=[0: RGB(39, 10, 100), 0.0963: RGB(0, 0, 128), 0.372: RGB(25, 105, 225), 0.661: RGB(0, 200, 255), 1: RGB(224, 255, 255)])
geo_3 = Geometry(geo_2)
col = Colour(gradient)
geo_4 = ClusterOutput(geo_3)
col_2 = ClusterOutput(col)

# ==== cluster Center: Center monospaced chars
geo = ClusterInput()
geo_2 = Geometry(geo)

bbox = BoundingBox(Content=geo_2, Plane=PlaneXY(0, 0, 0), UnionBox=True)  # -> Box, Box_2
debox = DeconstructBox(Box=bbox.Box)  # -> Plane, X, Y, Z
dedom = DeconstructDomain(Domain=debox.X)  # -> Start, End
subtraction = Subtraction(A=dedom.End, B=dedom.Start)
division = Division(A=subtraction, B=2)

rule_pt = ClusterInput()
rule_pt_2 = Point(rule_pt)
pdecon = Deconstruct(Point=rule_pt_2)  # -> XComponent, YComponent, ZComponent
division_2 = Division(A=pdecon.XComponent, B=2)
subtraction_2 = Subtraction(A=division_2, B=division)
round = Round(Number=subtraction_2)  # -> Nearest, Floor, Ceiling
X = UnitX(Factor=round.Floor)
move = Move(Geometry=geo_2, Motion=X)  # -> Geometry, Transform
G = ClusterOutput(move.Geometry)

# ==== cluster Srfs: Generate surfaces from geo
geo = ClusterInput()
geo_2 = Geometry(geo)
clean = CleanTree(RemoveNulls=True, RemoveInvalid=True, RemoveEmpty=False, Tree=geo_2)
filtertype = FilterByType(ObjectType="Point", Geometry=clean, invertFilter=False, returnNulls=False)  # -> ExcludedGeometry, IncludedGeometry
explode = Explode(Curve=filtertype.ExcludedGeometry, Recursive=True)  # -> Segments, Vertices
circle = CircleCNR(Center=filtertype.IncludedGeometry, Normal=Vector(0, 0, 1), Radius=0.5)

# ---- group: poly offset, requires clipper
polyoffset = PolylineOffset(
    Polylines=graft(explode.Segments),
    Distance=0.5,
    Plane=Plane(origin=(0, 0, 0), x=(0, 0, 0), y=(0, 0, 0)),
    Tolerance=0.01,
    ClosedFillet=0,
    OpenFillet=0,
    Miter=2)  # -> Contour, Holes

# ----
srf = Surface(circle)
trim = TrimTree(Tree=polyoffset.Contour, Depth=3)
srf_2 = Surface(trim)
merge = Merge(Data1=srf_2, Data2=srf)
geo_3 = Geometry(merge)
geo_4 = ClusterOutput(geo_3)
